# Grasshopper definition additive_manufacturing.ghx (Grasshopper 1.0.7)

# ----
# Ex1
bang = Button()
panel = Panel("Unload libraries")
unload = PythonScript(bang=bang)
# ---------- unload: Python ----------
from compas_rhino.utilities.misc import get_tolerance
from compas_rhino.utilities.misc import unload_modules

unload_modules("compas")
unload_modules("am_information_model")
# ---------- end unload ----------

pt = Point([Point(-0.3197334708, 0.1563492503, 0), Point(-0.1425674039, 0.7603244784, 0), Point(0.2016984761, 0.4502838613, 0), Point(-0.08820963338, -0.03289632121, 0), Point(0.1316360972, -0.2997548363, 0), Point(0.5962956252, -0.1899298805, 0), Point(0.4513415704, 0.2167467731, 0), Point(0.6023353775, 0.7643509799, 0), Point(0.6961582657, 0.5038417343, 0), Point(0.9788132697, 0.4, 0)])

# ----
# Points
# Predefine an element and its dimensions
# Visualise the defined element
show = BooleanToggle(True)
layer_def = GhPythonScript(pts=pt)  # -> out, layer; inputs pts: list of Point3d
# ---------- layer_def: Python ----------
import os
import sys
import json

from compas.geometry import Frame
from compas.geometry import Line
from compas.geometry import Vector

from am_information_model.model import Node
from am_information_model.model import Layer

def _radius_between_frames(from_frame, via_frame, to_frame, max_radius):
        in_line = Line(from_frame.point, via_frame.point)
        out_line = Line(via_frame.point, to_frame.point)
        r = min(max_radius, in_line.length/2, out_line.length/2)
        return r

# nodes
max_r = 0.2
nodes = []
frames = [Frame([pt.X, pt.Y, pt.Z], [1, 0, 0], [0, -1, 0]) for pt in pts]

for i,frame in enumerate(frames):
    r = _radius_between_frames(frames[max(0,i-1)], frame, frames[min(i+1, len(frames)-1)], max_r)
    nodes.append(Node(frame, radius=r))
layer = Layer.from_nodes(nodes)
# ---------- end layer_def ----------
draw = PythonScript(layer=layer_def.layer, show=show)  # -> M, F, S
# ---------- draw: Python ----------
from compas.geometry import Transformation
from compas.geometry import Frame
from compas.datastructures import mesh_transformed
from compas_ghpython.artists import MeshArtist
from compas_ghpython import draw_frame

if show:
    F = [draw_frame(node.frame) for node in layer.nodes]
# ---------- end draw ----------

# ----
# AMIM
toggle = BooleanToggle(False)
cp = Plane(PlaneXY(0, 0, 0))
cp_new = Plane(PlaneXY(0.8, 0.4, 0))
generate_assembly = GhPythonScript(centerplane=cp, layer=layer_def.layer, transform=toggle, ptransf=cp_new)  # -> amim, planes; inputs ptransf: Plane
# ---------- generate_assembly: Python ----------
import Rhino.Geometry as rg
import math
from scriptcontext import sticky as st


from compas.geometry import Frame
from compas.geometry import Transformation
from compas.geometry import Rotation
from compas.geometry import Translation
from compas.geometry import Point

from compas_ghpython import draw_frame

from am_information_model.model import AMModel
from am_information_model.model import Layer

import Rhino.Geometry as rg


# initialize an empty assembly class
ammodel = AMModel()

cp = centerplane
cf = Frame(cp.Origin, cp.XAxis, cp.YAxis)

layer_height = 0.007

for i in range(25): # loop through the number of layers i

    T = Translation.from_vector([0,0,layer_height*i])
    cft = cf.transformed(T) #transforms the origin plane
    
    T1 = Transformation.from_frame_to_frame(Frame.worldXY(), cft)
    
    # create new instances of the element
    new_layer = layer.transformed(T1) #returns a deep copy of the initial element at the new location of the frame

    ammodel.add_layer(new_layer)

if transform:
    T = Transformation.from_frame_to_frame(cf, Frame(ptransf.Origin, ptransf.XAxis, ptransf.YAxis))
    ammodel.transform(T)
# ---------- end generate_assembly ----------
pln = Plane(generate_assembly.planes)

list = ValueList({"20", "50", "100", "500", "1000", "5000"}, selected="50")
back = Button()
reset = Button()
start = Button()
stop = Button()
step = Button()
full = Button()

# ----
# Draw
counter = CountThroughList(amim=generate_assembly.amim, start=start, stop=stop, step=step, step_back=back, reset=reset, full=full, interval=list)  # -> item, counter; inputs start: Boolean, stop: Boolean, step_back: Boolean
# ---------- counter: Python ----------
from scriptcontext import sticky as st
from compas_ghpython import update_component


L = list(amim.layers())
# store data in component
guid = str(ghenv.Component.InstanceGuid)
counter_key = "counter_" + guid
running_key = "running_" + guid

if counter_key not in st:
    st[counter_key] = 0

if running_key not in st:
    st[running_key] = False
    

if st[running_key]:
    if st[counter_key] < len(L) - 1:
        st[counter_key] += 1
        update_component(ghenv, interval)
    else:
        st[counter_key] = 0
        st[running_key] = False
    
    
if start:
    st[running_key] = True

if stop:
    st[running_key] = False

if step:
    if st[counter_key] < len(L) - 1:
        st[counter_key] += 1

if step_back:
    if st[counter_key] < len(L) - 1:
        st[counter_key] -= 1

if reset:
    st[counter_key] = 0

if full:
    st[counter_key] = len(L)-1

if len(L):
    item = L[st[counter_key]]



#st["visualisation_counter"] = st[counter_key]
counter = st[counter_key]
# ---------- end counter ----------
show_2 = BooleanToggle(True)
show_3 = BooleanToggle(True)
idx = Panel(counter.counter)
draw_2 = PythonScript(amim=generate_assembly.amim, show_all=show_2, show_counter=show_3, counter=idx)  # -> G, start_planes_WCS, current_tool_plane; inputs counter: Int32
# ---------- draw_2: Python ----------
import os
import sys

import math

from compas_ghpython.artists import MeshArtist
from compas_ghpython import draw_frame


G = []

key_index = amim.network.key_index()
keys = [key_index[key] for key in amim.network.nodes()]
layers = [amim.layer(key) for key in keys]
#print elements
#print([(e.gripping_frame) for e in elements])

start_planes_WCS = [draw_frame(l.start_node.frame) for l in layers]

current_tool_plane = start_planes_WCS[counter]

if show_all and not show_counter:
    for layer in layers:
        for n in layer.nodes:
            plane = draw_frame(n.frame) 
            G.append(plane)

if show_counter:
    for layer in layers[0:counter+1]:
        for n in layer.nodes:
            plane = draw_frame(n.frame) 
            G.append(plane)

    tool_planes_WCS = [draw_frame(l.start_node.tool_frame) for l in layers[0:counter+1]]
# ---------- end draw_2 ----------
pln_2 = Plane(draw_2.start_planes_WCS)
pln_3 = Plane(draw_2.current_tool_plane)
geo = Geometry(draw_2.G)
preview = CustomPreview(Geometry=geo, Shader=ColourSwatch(SwatchColor=RGBA(255, 227, 227, 233)))
preview_2 = CustomPreview(Geometry=[pln_2, pln_3], Shader=ColourSwatch(SwatchColor=RGBA(209, 27, 27, 178)))
