# Grasshopper definition additive_manufacturing_py3.ghx (Grasshopper 1.0.8)

# ----
# Ex1
bang = Button()
panel = Panel("Unload libraries")
unload = Python3Script(bang=bang)
# ---------- unload: Python ----------
#from compas_rhino.utilities.misc import get_tolerance
from compas_ghpython import unload_modules

unload_modules("compas")
unload_modules("am_information_model")
# ---------- end unload ----------

# ----
# Ex2
# Curve
# Predefine an element and its dimensions
# Visualise the defined element
number_slider = Slider(0.2, range=0..1)
show = BooleanToggle(False)
crv = Curve(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)
layer_def = Python3Script(crv=crv, div_length=number_slider)  # -> out, layer
# ---------- layer_def: Python ----------
import rhinoscriptsyntax as rs
import os
import sys
import json

from compas.geometry import Frame
from compas.geometry import Line
from compas.geometry import Vector

from am_information_model.model import Node
from am_information_model.model import Path

def _radius_between_frames(from_frame, via_frame, to_frame, max_radius):
        in_line = Line(from_frame.point, via_frame.point)
        out_line = Line(via_frame.point, to_frame.point)
        r = min(max_radius, in_line.length/2, out_line.length/2)
        return r

# nodes
print(crv)
pts = rs.DivideCurveLength(crv, div_length)
max_r = div_length/2
nodes = []
frames = [Frame([pt.X, pt.Y, pt.Z], [0, -1, 0], [-1, 0, 0]) for pt in pts]

for i,frame in enumerate(frames):
    r = _radius_between_frames(frames[max(0,i-1)], frame, frames[min(i+1, len(frames)-1)], max_r)
    nodes.append(Node(frame = frame, radius=r))
layer = Path.from_path_nodes(nodes)
# ---------- end layer_def ----------
draw = Python3Script(layer=layer_def.layer, show=show)  # -> M, F, S
# ---------- draw: Python ----------
from compas.geometry import Transformation
from compas.geometry import Frame
#from compas.datastructures import mesh_transformed
#from compas_ghpython.artists import MeshArtist
#from compas_ghpython import draw_frame

if show:
    F = [frame_to_rhino(node["path_node"].frame) for key, node in layer.nodes(True)]
# ---------- end draw ----------

pt = Point([Point(-0.6988636097, -0.467318018, 0), Point(-1.104355128, -0.3483738393, 0), Point(-0.8962028153, -0.1172436739, 0), Point(-0.5718096007, -0.3118796027, 0), Point(-0.3920416942, -0.1618477409, 0), Point(-0.4663818059, 0.1476774514, 0), Point(-0.7394127616, 0.05035948698, 0), Point(-1.107058405, 0.1517323665, 0), Point(-0.9321600238, 0.214722343, 0), Point(-0.8624436836, 0.4044887463, 0)])

# ----
# Points
# Predefine an element and its dimensions
# Visualise the defined element
layer_def_2 = Python3Script(pts=pt)  # -> out, layer; inputs pts: list of Point3d
# ---------- layer_def_2: Python ----------
import os
import sys
import json

from compas.geometry import Frame
from compas.geometry import Line
from compas.geometry import Vector

from am_information_model.model import Node
from am_information_model.model import Path

from compas_rhino.conversions import point_to_compas

def _radius_between_frames(from_frame, via_frame, to_frame, max_radius):
        in_line = Line(from_frame.point, via_frame.point)
        out_line = Line(via_frame.point, to_frame.point)
        r = min(max_radius, in_line.length/2, out_line.length/2)
        return r

# nodes
max_r = 0.2
nodes = []
frames = [Frame([pt.X, pt.Y, pt.Z], [0, -1, 0], [-1, 0, 0]) for pt in pts]

for i,frame in enumerate(frames):
    #r = _radius_between_frames(frames[max(0,i-1)], frame, frames[min(i+1, len(frames)-1)], max_r)
    nodes.append(Node(frame = frame)) #radius=r))
layer = Path.from_path_nodes(nodes)
print(layer)
# ---------- end layer_def_2 ----------
draw_2 = Python3Script(layer=layer_def_2.layer, show=Toggle(True))  # -> M, F, S
# ---------- draw_2: Python ----------
from compas.geometry import Transformation
from compas.geometry import Frame
from compas_rhino.conversions import frame_to_rhino
#from compas.datastructures import mesh_transformed
#from compas_ghpython.artists import MeshArtist

if show:
    #F = [draw_frame(node.frame) for key, node in layer.nodes(True)]
    F = [frame_to_rhino(node["path_node"].frame) for key, node in layer.nodes(True)]

print(F)
# ---------- end draw_2 ----------

# ----
# AM Model
number_slider_2 = Slider(0.006, range=0..0.01)
cp = Plane(PlaneXY(0, 0, 0))
generate_assembly = Python3Script(centerplane=cp, layer=layer_def_2.layer, layer_height=number_slider_2)  # -> am_model, planes; inputs layer_height: Double
# ---------- generate_assembly: Python ----------
import Rhino.Geometry as rg
import math
from scriptcontext import sticky as st


from compas.geometry import Frame
from compas.geometry import Transformation
from compas.geometry import Rotation
from compas.geometry import Translation
from compas.geometry import Point

from compas_ghpython.scene import FrameObject

from am_information_model.model import InformationModel
from am_information_model.model import Path, Element

import Rhino.Geometry as rg


# initialize an empty assembly class
am_model = InformationModel()
element = Element()

cp = centerplane
cf = Frame(cp.Origin, cp.XAxis, cp.YAxis)

for i in range(25): # loop through the number of layers i
    T = Translation.from_vector([0,0,layer_height*i])
    cft = cf.transformed(T) #transforms the origin plane

    T1 = Transformation.from_frame_to_frame(cf, cft)
    # create new instances of the element
    new_layer = layer.transformed(T) #returns a deep copy of the initial element at the new location of the frame
    #print(new_layer.node(0).frame)
    element.add_path(new_layer)

am_model.add_element(element)
# ---------- end generate_assembly ----------
pln = Plane(generate_assembly.planes)

# ----
# AM Model
number_slider_3 = Slider(0.006, range=0..0.01)
cp_2 = Plane(PlaneXY(0, 0, 0))
generate_assembly_2 = Python3Script(centerplane=cp_2, layer=layer_def.layer, layer_height=number_slider_3)  # -> am_model, planes; inputs layer_height: Double; same code as generate_assembly
pln_2 = Plane(generate_assembly_2.planes)

trigger = Trigger(Interval=1000, TimerInterval=1000, Target=counter_2)

back = Button()
reset = Button()
start = Button()
stop = Button()
step = Button()
full = Button()

trigger_2 = Trigger(Interval=1000, TimerInterval=1000, Target=counter)

back_2 = Button()
reset_2 = Button()
start_2 = Button()
stop_2 = Button()
step_2 = Button()
full_2 = Button()

counter = Python3Script(
    am_model=generate_assembly_2.am_model,
    start=start_2,
    stop=stop_2,
    step=step_2,
    step_back=back_2,
    reset=reset_2,
    full=full_2)  # -> item, counter
# ---------- counter: Python ----------
from scriptcontext import sticky as st
#from compas_ghpython import update_component

element = am_model.get_element(0)
layers = [layer for key, layer in element.paths(True)]

L = list(layers)
# store data in component
guid = str(ghenv.Component.InstanceGuid)
counter_key = "counter_" + guid
running_key = "running_" + guid

if counter_key not in st:
    st[counter_key] = 0

if running_key not in st:
    st[running_key] = False
    

if st[running_key]:
    if st[counter_key] < len(L) - 1:
        st[counter_key] += 1
        #update_component(ghenv, interval)
    else:
        st[counter_key] = 0
        st[running_key] = False
    
    
if start:
    st[running_key] = True

if stop:
    st[running_key] = False

if step:
    if st[counter_key] < len(L) - 1:
        st[counter_key] += 1

if step_back:
    if st[counter_key] < len(L) - 1:
        st[counter_key] -= 1

if reset:
    st[counter_key] = 0

if full:
    st[counter_key] = len(L)-1

if len(L):
    item = L[st[counter_key]]



#st["visualisation_counter"] = st[counter_key]
counter = st[counter_key]

print(st[counter_key])
# ---------- end counter ----------

# ----
# Draw
idx = Panel(counter.counter)

show_2 = BooleanToggle(False)
show_3 = BooleanToggle(False)
draw_3 = Python3Script(am_model=generate_assembly_2.am_model, show_all=show_2, show_counter=show_3, counter=idx)  # -> G, tool_planes_WCS, current_tool_plane, current_tool_planes; inputs counter: Int32
# ---------- draw_3: Python ----------
import os
import sys

import math

#from compas_ghpython.artists import MeshArtist
from compas_rhino.conversions import frame_to_rhino_plane

from compas.geometry import Frame


G = []

key_index = am_model.elements()
element = am_model.get_element(0)
#print(element)
layers = [layer for key, layer in element.paths(True)]
#print(layers)

#keys = [key_index[key] for key in am_model.network.nodes()]
#layers = [am_model.layer(key) for key in keys]
#print elements
#print([(e.gripping_frame) for e in elements])

start_planes_WCS = [frame_to_rhino_plane(l.node[0]["path_node"].frame) for l in layers]

current_tool_plane = start_planes_WCS[counter]
current_tool_planes = [frame_to_rhino_plane(node["path_node"].frame) for key, node in layers[(counter)].nodes(True)]

#print(start_planes_WCS)
#print(current_tool_plane)
#print(current_tool_planes)


if show_all and not show_counter:
    for layer in layers:
        for key, node in layer.nodes(True):
            plane = frame_to_rhino_plane(node["path_node"].frame) 
            G.append(plane)

if show_counter:
    for layer in layers[0:counter+1]:
        for key, node in layer.nodes(True):
            plane = frame_to_rhino_plane(node["path_node"].frame) 
            G.append(plane)

    tool_planes_WCS = [frame_to_rhino_plane(l.node[0]["path_node"].frame) for l in layers[0:counter+1]]
# ---------- end draw_3 ----------
geo = Geometry(draw_3.G)
pln_3 = Plane(draw_3.tool_planes_WCS)
pln_4 = Plane(draw_3.current_tool_plane)
pln_5 = Plane(draw_3.current_tool_planes)
preview = CustomPreview(Geometry=geo, Shader=ColourSwatch(SwatchColor=RGBA(255, 227, 227, 233)))
preview_2 = CustomPreview(Geometry=[pln_3, pln_4], Shader=ColourSwatch(SwatchColor=RGBA(209, 27, 27, 178)))

counter_2 = Python3Script(am_model=generate_assembly.am_model, start=start, stop=stop, step=step, step_back=back, reset=reset, full=full)  # -> item, counter; same code as counter
show_4 = BooleanToggle(False)
show_5 = BooleanToggle(True)

# ----
# Draw
idx_2 = Panel(counter_2.counter)

draw_4 = Python3Script(am_model=generate_assembly.am_model, show_all=show_4, show_counter=show_5, counter=idx_2)  # -> G, tool_planes_WCS, current_tool_plane, current_tool_planes; inputs counter: Int32; same code as draw_3
pln_6 = Plane(draw_4.tool_planes_WCS)
geo_2 = Geometry(draw_4.G)
pln_7 = Plane(draw_4.current_tool_plane)
preview_3 = CustomPreview(Geometry=geo_2, Shader=ColourSwatch(SwatchColor=RGBA(255, 227, 227, 233)))
preview_4 = CustomPreview(Geometry=[pln_6, pln_7], Shader=ColourSwatch(SwatchColor=RGBA(209, 27, 27, 178)))

pln_8 = Plane(draw_4.current_tool_planes)
